% Simulink data dictionary params.sldd

Qomx = Simulink.Parameter(0.001, StorageClass="Struct", Alias="Qomx", StructName="controlParams", DataType="single")
Romx = Simulink.Parameter(0.001, StorageClass="Struct", Alias="Romx", StructName="controlParams", DataType="single")
Qphi = Simulink.Parameter(0.001, StorageClass="Struct", Alias="Qphi", StructName="controlParams", DataType="single")
m = Simulink.Parameter(100, StorageClass="Struct", Alias="bikeMass", StructName="controlParams", DataType="single")
h = Simulink.Parameter(1, StorageClass="Struct", Alias="COGheight", StructName="controlParams", DataType="single")
r_t = Simulink.Parameter(0.06, StorageClass="Struct", Alias="torusRadius", StructName="controlParams", DataType="single")
Ix = Simulink.Parameter(10, StorageClass="Struct", Alias="rollInertia", StructName="controlParams", DataType="single")
Iw = Simulink.Parameter(0.3, StorageClass="Struct", Alias="wheelInertia", StructName="controlParams", DataType="single")
rr = Simulink.Parameter(0.3, StorageClass="Struct", Alias="rollingRadius", StructName="controlParams", DataType="single")
g = Simulink.Parameter(9.806, StorageClass="Struct", Alias="gravity", StructName="controlParams", DataType="single")
Trth = Simulink.Parameter(0.5, StorageClass="Struct", Alias="riderTrqTreshold", StructName="controlParams", DataType="single")
taub = Simulink.Parameter(1.25, StorageClass="Struct", Alias="beltRatio", StructName="controlParams", DataType="single")
taug = Simulink.Parameter(36, StorageClass="Struct", Alias="gearRatio", StructName="controlParams", DataType="single")
kt = Simulink.Parameter(0.0404, StorageClass="Struct", Alias="trqConstant", StructName="controlParams", DataType="single")
kctrl = Simulink.Parameter(0.5, StorageClass="Struct", Alias="trqGainControl", StructName="controlParams", DataType="single")
Ts = Simulink.Parameter(0.001, DataType="double")
Pspeed = Simulink.Parameter(1, StorageClass="Struct", Alias="propGainSpeed", StructName="controlParams", DataType="single")
Ispeed = Simulink.Parameter(0, StorageClass="Struct", Alias="intGainSpeed", StructName="controlParams", DataType="single")
Dspeed = Simulink.Parameter(0, StorageClass="Struct", Alias="derGainSpeed", StructName="controlParams", DataType="single")
Vmax = Simulink.Parameter(8, StorageClass="Struct", Alias="maxSpeed", StructName="controlParams", DataType="single")
iamax = Simulink.Parameter(10, StorageClass="Struct", Alias="maxCurrent", StructName="controlParams", DataType="single")